# Grasshopper definition 00_anatomy_of_code_hs24.gh (Grasshopper 1.0.7)

# ----
# Anatomy of code
python = GhPythonScript()  # -> out, a
# ---------- python: Python ----------
# ------------ Comments -------------
# Single line comments start with a hash.

"""
This is a multi-line comment.
It can span multiple lines.
Ideal for longer descriptions.
"""

# -----------------------------------
# ----------- Data Types ------------

# Integer: Whole numbers without a decimal point.
integer_example = 42

# Float: Numbers that include a decimal point.
float_example = 4.2429

# String: A sequence of characters in either single or double quotes.
string_example = "42"

# Boolean: Represents two values: True or False.
boolean_example = True

# ------------------------------------
# ---- Expressions and Statements ----

# Expression: A combination of values and functions that are combined and interpreted by the compiler to create a new value.
expression_example = 42 * 10  # Multiplies 42 by 10
addition_example = 3 + 5      # Adds 3 and 5

# Using a function in an expression
from math import sqrt
sqrt_example = sqrt(64)       # Calculates the square root of 64

# Statements: Instructions that a Python interpreter can execute.
print(42)                     # Prints 42 to the console

# Conditional statement
x = True
if x:
    print("x is True")        # Executes if x is True

# Return statement in a function
def get_number():
    return 42                 # Returns 42 from this function

# -------------------------------------
# ------------ Assignments ------------

# Assigning a value to a variable
a = 10                        # Assigns the integer 10 to variable a

# Assigning the result of an expression to a variable
b = a * 2                     # Multiplies a by 2 and stores the result in b

# -------------------------------------
# --------- Control Structures --------

# If statement
if b > 10:
    print("b is greater than 10")

# For loop
for i in range(5):
    print(i)                  # Prints numbers 0 to 4

# While loop
count = 0
while count < 5:
    print(count)
    count += 1                # Prints numbers 0 to 4, incrementing count each time

# ----------------------------
# --------- Functions --------

# Defining a simple function
def add_numbers(x, y):
    return x + y              # Returns the sum of x and y

# Calling a function
result = add_numbers(5, 3)
print(result)                 # Prints 8

# --------------------------------------------
# --------- Lists and Dictionaries(?) --------

# List: An ordered collection of items
fruits = ["apple", "banana", "cherry"]
print(fruits[1])              # Access the second element: banana

# Dictionary: A collection of key-value pairs
person = {"name": "John", "age": 30}
print(person["name"])         # Access value of the key "name"

# Using list in a loop
for fruit in fruits:
    print(fruit)              # Prints each fruit in the fruits list

# Using dictionary keys in a loop
for key in person:
    print(key, person[key])   # Prints each key and value pair in the person dictionary
# ---------- end python ----------
