# Grasshopper definition 02_operators_hs24.gh (Grasshopper 1.0.7)

# ----
# Grasshopper
# Comparison operators
# Comparison component
number_slider = Slider(10, range=0..20)
# GHPython
number_slider_2 = Slider(11, range=0..20)
larger_than = LargerThan(FirstNumber=number_slider, SecondNumber=number_slider_2)  # -> LargerThan, OrEqualTo
panel = Panel(larger_than.LargerThan)

# ----
# Expression component
number_slider_3 = Slider(10, range=0..20)
expression = Expression(x=number_slider_3, y=Slider(11, range=0..20), Expression="x > y")
panel_2 = Panel(expression)

# ----
# Grasshopper
# Logical operators
# AND operator
number_slider_4 = Slider(2, range=0..20)
# GHPython
number_slider_5 = Slider(2, range=0..20)
gate_and = GateAnd(A=number_slider_4, B=number_slider_5)
panel_3 = Panel(gate_and)

# ----
# OR operator
number_slider_6 = Slider(0, range=0..20)
gate_or = GateOr(A=number_slider_6, B=Slider(0, range=0..20))
panel_4 = Panel(gate_or)

# ----
# Comparison operators
number_slider_7 = Slider(10, range=0..20)

# ----
# Comparison expression in a conditional statement
python = GhPythonScript(x=number_slider_7, y=Slider(11, range=0..20))  # -> out, result; inputs x: Int32, y: Int32
# ---------- python: Python ----------
result = x > y
# ---------- end python ----------

panel_5 = Panel(python.result)

# ----
# More comparison operators
python_2 = GhPythonScript(x=Slider(10, range=0..20), y=Slider(11, range=0..20))  # -> out; inputs x: Int32, y: Int32
# ---------- python_2: Python ----------
print(x < y)   # Will check if x is smaller than y.
print(x <= y)  # Will check if x is smaller or equal than/to y.
print(x == y)  # Will check if x is equals or y.
print(x > y)   # Will check if x is larger than y.
print(x >= y ) # Will check if x is larger or equal than y.
print(x != y)  # Will check if x is NOT equals or y.
# ---------- end python_2 ----------

panel_6 = Panel(python_2)

# ----
# Logical operators
number_slider_8 = Slider(0, range=0..20)

# ----
# AND operator
python_3 = GhPythonScript(x=number_slider_8, y=Slider(0, range=0..20))  # -> out, result; inputs x: Boolean, y: Boolean
# ---------- python_3: Python ----------
result = x and y
# ---------- end python_3 ----------

panel_7 = Panel(python_3.result)

# ----
# OR operator
python_4 = GhPythonScript(x=Slider(0, range=0..20), y=Slider(0, range=0..20))  # -> out, result; inputs x: Boolean, y: Boolean
# ---------- python_4: Python ----------
result = x or y
# ---------- end python_4 ----------

panel_8 = Panel(python_4.result)

# ----
# NOT operator
number_slider_9 = Slider(0, range=0..20)
gate_and_2 = GateAnd(A=number_slider_9, B=Slider(0, range=0..20))

gate_not = GateNot(A=gate_and_2)

panel_9 = Panel(gate_not)

# ----
# NOT operator
python_5 = GhPythonScript(x=Slider(0, range=0..20), y=Slider(0, range=0..20))  # -> out, result; inputs x: Boolean, y: Boolean
# ---------- python_5: Python ----------
result = not(x and y)
# ---------- end python_5 ----------

panel_10 = Panel(python_5.result)
