# Grasshopper definition 02-sets-and-duplicates.gh (Grasshopper 1.0.7)

# ----
# Sets - Remove duplicates and order
# set()
panel = Panel("""0
0
1
3
6
2
3
4
4""")
python = GhPythonScript(lst=panel)  # -> out, new_lst; inputs lst: list
# ---------- python: Python ----------
new_lst = set(lst)
# ---------- end python ----------
panel_2 = Panel(python.new_lst)

# ----
# for loop, list
panel_3 = Panel("""0
0
1
3
6
2
3
4
4""")
python_2 = GhPythonScript(lst=panel_3)  # -> out, new_lst, duplicates; inputs lst: list
# ---------- python_2: Python ----------
new_lst = []
duplicates = []

for item in lst:
    if item not in new_lst:
        new_lst.append(item)
    else:
        duplicates.append(item)

print(new_lst)
print(duplicates)
# ---------- end python_2 ----------
panel_4 = Panel(python_2.new_lst)
panel_5 = Panel(python_2.duplicates)

# ----
# Remove point duplicates, sorted(), set()
pt = Point([Point(0, 0, 0), Point(0, 0, 0), Point(2.018933482, 2.364697172, 0), Point(4.052529624, 1.37538013, 0), Point(4.052529624, 1.37538013, 0), Point(2.018933482, 2.364697172, 0), Point(3.11817464, 3.683786562, 0), Point(4.478485573, 3.395235758, 0), Point(0.9059518091, 4.082261482, 0), Point(0.9059518091, 1.444082702, 0), Point(1.867787822, 0.7295759497, 0), Point(3.200617726, 0.5509492615, 0), Point(3.722757277, 5.95097145, 0), Point(5.85253702, 4.233407141, 0), Point(6.828113548, 2.034924825, 0), Point(6.951778178, 5.896009392, 0), Point(0.8235087222, 6.844104891, 0), Point(3.76397882, 8.341820969, 0), Point(5.028106152, 7.228839297, 0)])
python_3 = GhPythonScript(lst=pt)  # -> new_lst, new_lst_length; inputs lst: list of Point3d
# ---------- python_3: Python ----------
new_lst = sorted(set(lst))
new_lst_length = len(new_lst)
# ---------- end python_3 ----------

points = PointList(Points=python_3.new_lst, Size=0.5)
panel_6 = Panel(python_3.new_lst_length)
panel_7 = Panel(python_3.new_lst)

# ----
# set(), sorted()
panel_8 = Panel("""0
0
1
3
6
2
3
4
4""")
python_4 = GhPythonScript(lst=panel_8)  # -> out, new_lst; inputs lst: list
# ---------- python_4: Python ----------
new_lst = sorted(set(lst))
print(new_lst)
# ---------- end python_4 ----------
panel_9 = Panel(python_4.new_lst)

lst_01 = Panel("""10
0
11
6
4
3
3""")
# set(), set operations, union(), sorted()
lst = Panel("""0
0
1
3
6
2
3
4
4""")
python_5 = GhPythonScript(lst=lst, lst_01=lst_01)  # -> out, lst_intersection, lst_difference, lst_01_difference, lst_union; inputs lst: list, lst_01: list
# ---------- python_5: Python ----------
lst_intersection = set(lst) & set(lst_01)
lst_intersection = sorted(set(lst_intersection))

lst_difference = set(lst) - set(lst_01)
lst_difference = sorted(set(lst_difference))

lst_01_difference = set(lst_01) - set(lst)
lst_01_difference = sorted(set(lst_01_difference))

lst_union = set(lst).union(lst_01)
# ---------- end python_5 ----------
union = Panel(python_5.lst_union)
difference = Panel(python_5.lst_difference)
difference_2 = Panel(python_5.lst_01_difference)
intersection = Panel(python_5.lst_intersection)

# ----
# Remove duplicate columns with tolerance
# set(), add(), if, for loop, geometry_key()
brep = Brep([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])

python_6 = GhPythonScript(columns=brep)  # -> a; inputs columns: list of Box
# ---------- python_6: Python ----------
from compas.utilities import geometric_key

unique_centers = set()
unique_columns = set()

for col in columns:
    center = geometric_key(col.Center, 2)
    if center not in unique_centers:
        unique_centers.add(center)
        unique_columns.add(col)

print len(unique_columns)
a = unique_columns
# ---------- end python_6 ----------

brep_2 = Brep(python_6)
