# Grasshopper definition 01-brick-objects.gh (Grasshopper 1.0.7)

# ----
# 5. Add a point to the brick class
# 6. Create multiple bricks in a for loop
number_slider = Slider(10, range=0..50)
ghpython_script = GhPythonScript(
    bricks_amount=number_slider,
    width=Slider(40, range=0..500),
    height=Slider(20, range=0..500),
    depth=Slider(100, range=0..500),
    gap=Slider(5, range=0..50))  # -> out, bricks; inputs bricks_amount: Int32, gap: Int32
# ---------- ghpython_script: Python ----------
from compas.geometry import Box
from compas.geometry import Point

class Brick(object):
    def __init__(self, point, width, height, depth):
        self.point = point
        self.width = width
        self.height = height
        self.depth = depth
    
    def create_geometry(self):
        corner1 = self.point
        corner2 = Point((self.point.x + self.width), (self.point.y + self.depth), self.point.z) # corner1 and corner2 are on the same plane
        return Box.from_corner_corner_height(corner1, corner2, self.height)

bricks = []
for i in range(bricks_amount):
    point = Point(0, i*(depth + gap), 0)
    my_brick = Brick(point, width, height, depth)
    geometry = my_brick.create_geometry()
    
    bricks.append(geometry)
# ---------- end ghpython_script ----------
draw = Draw(cg=ghpython_script.bricks)  # -> rg
#   port cg: The COMPAS geometry or datastructure to be drawn.
#   port rg: The Rhino geometry object.
# ---------- draw: Python ----------
"""
Draws COMPAS geometry in Grasshopper.
"""
from ghpythonlib.componentbase import executingcomponent as component

from compas.artists import Artist


class CompasToRhinoGeometry(component):
    def RunScript(self, cg):
        if not cg:
            return None

        return Artist(cg).draw()
# ---------- end draw ----------

# ----
# week 04
# objects & classes
# exercise
# 1. Create a Brick class
# 2. Add attributes: width, height, depth
# 3. Add method to create geometry
# 4. Visualize it
number_slider_2 = Slider(40, range=0..500)
# brownie points!
number_slider_3 = Slider(100, range=0..500)
ghpython_script_2 = GhPythonScript(width=number_slider_2, height=Slider(20, range=0..500), depth=number_slider_3)  # -> out, geometry
# ---------- ghpython_script_2: Python ----------
from compas.geometry import Box

class Brick(object):
    def __init__(self, width, height, depth):
        self.width = width
        self.height = height
        self.depth = depth
    
    def create_geometry(self):
        return Box.from_width_height_depth(self.width, self.height, self.depth)

my_brick = Brick(width, height, depth)
geometry = my_brick.create_geometry()
# ---------- end ghpython_script_2 ----------
draw_2 = Draw(cg=ghpython_script_2.geometry)  # -> rg; same code as draw
