# Grasshopper definition 01-building-grid-facade.gh (Grasshopper 1.0.7)

# ---- group: Grid size
number_slider = Slider(9, range=0..20)
number_slider_2 = Slider(18, range=0..20)
number_slider_3 = Slider(9, range=0..20)

# ---- group: Cell sizes
number_slider_4 = Slider(5, range=0..20)
number_slider_5 = Slider(4.5, range=0..20)
number_slider_6 = Slider(3.5, range=0..20)

# ---- group: Options
main_beam_width = Slider(0.35, range=0.1..0.9)
main_beam_height = Slider(0.4, range=0.1..0.9)
column_width_x = Slider(0.35, range=0.1..0.9)
column_depth_y = Slider(0.45, range=0.1..0.9)
slab_height = Slider(0.2, range=0.1..0.9)

# ----
facade_thickness = Slider(0.2, range=0.1..0.9)

# ----
# Applying classes to create buildings
# Filters selection
modulo_filter = GhPythonScript()  # -> mfilter
# ---------- modulo_filter: Python ----------
# Sample filter
class ModuleBasedFilter(object):
    def is_included(self, x, y, z):
        if (x + y) % 2 == 0:
            return True

        return False

mfilter = ModuleBasedFilter()
# ---------- end modulo_filter ----------
random_filter = GhPythonScript()  # -> rfilter
# ---------- random_filter: Python ----------
# Sample filter
from random import choice

class RandomFilter(object):
    def is_included(self, x, y, z):
        return choice([True, False])

rfilter = RandomFilter()
# ---------- end random_filter ----------
linear_filter = GhPythonScript()  # -> lfilter
# ---------- linear_filter: Python ----------
# Sample filter
class LinearFilter(object):
    def __init__(self, coefficient=1, vertical_shift_x=0, vertical_shift_y=0, horizontal_shift_x=0, horizontal_shift_y=0):
        super(LinearFilter, self).__init__()
        self.coefficient = coefficient
        self.vertical_shift_x = vertical_shift_x
        self.vertical_shift_y = vertical_shift_y
        self.horizontal_shift_x = horizontal_shift_x
        self.horizontal_shift_y = horizontal_shift_y

    def is_included(self, x, y, z):
        z_range_x = (self.coefficient * x + self.vertical_shift_x) + self.horizontal_shift_x
        z_range_y = (self.coefficient * y + self.vertical_shift_y) + self.horizontal_shift_y
        return not z_range_x < z > z_range_y

lfilter = LinearFilter(coefficient= 3, vertical_shift_x= -3, vertical_shift_y=-3, horizontal_shift_x=0, horizontal_shift_y=0)
# ---------- end linear_filter ----------
paraboloid_filter = GhPythonScript()  # -> pfilter
# ---------- paraboloid_filter: Python ----------
# Solution of assignment 02: main task
class ParaboloidFilter(object):
    def __init__(self, coefficient=1, shift_x=0, shift_y=0):
        super(ParaboloidFilter, self).__init__()
        self.coefficient = coefficient
        self.shift_x = shift_x
        self.shift_y = shift_y

    def is_included(self, x, y, z):
        return (x - self.shift_x) ** 2 + (y - self.shift_y) ** 2 > self.coefficient * z

pfilter = ParaboloidFilter(coefficient=4, shift_x=0, shift_y=0)
# ---------- end paraboloid_filter ----------
value_list = ValueList({"Modulo filter": 0, "Random filter": 1, "Linear filter": 2, "Paraboloid filter": 3, "Merge filter": 4}, selected="Paraboloid filter")

merge = Merge(Data1=modulo_filter, Data2=paraboloid_filter)
merge_filter = GhPythonScript(sub_filters=merge)  # -> mfilter; inputs sub_filters: list
# ---------- merge_filter: Python ----------
# Solution of assignment 02: challenge 02
class MergeFilter(object):
    def __init__(self, sub_filters):
        self.sub_filters = sub_filters

    def is_included(self, x, y, z):
        for subfilter in self.sub_filters:
            if not subfilter.is_included(x, y, z):
                return False

        return True

mfilter = MergeFilter(sub_filters)
# ---------- end merge_filter ----------

stream_filter = StreamFilter(
    Gate=value_list,
    Stream0=modulo_filter,
    Stream1=random_filter,
    Stream2=linear_filter,
    Stream3=paraboloid_filter,
    Stream4=merge_filter)

# ----
# Create grid based on volumetric mesh
python = GhPythonScript()  # -> from_meshgrid
# ---------- python: Python ----------
from itertools import product
from compas.datastructures import VolMesh
from compas.utilities import linspace

def from_meshgrid(selected_filter, dx, dy, dz, nx, ny, nz):
    vertices = [
        [x*nx, y*ny, z*nz]
        for z, x, y in product(
            linspace(0, dz, nz + 1),
            linspace(0, dx, nx + 1),
            linspace(0, dy, ny + 1),
        )
    ]

    cells = []
    for k, i, j in product(range(nz), range(nx), range(ny)):
        if not selected_filter.is_included(j, i, k):
            continue
        a = k * ((nx + 1) * (ny + 1)) + i * (ny + 1) + j
        b = k * ((nx + 1) * (ny + 1)) + (i + 1) * (ny + 1) + j
        c = k * ((nx + 1) * (ny + 1)) + (i + 1) * (ny + 1) + j + 1
        d = k * ((nx + 1) * (ny + 1)) + i * (ny + 1) + j + 1
        aa = (k + 1) * ((nx + 1) * (ny + 1)) + i * (ny + 1) + j
        bb = (k + 1) * ((nx + 1) * (ny + 1)) + (i + 1) * (ny + 1) + j
        cc = (k + 1) * ((nx + 1) * (ny + 1)) + (i + 1) * (ny + 1) + j + 1
        dd = (k + 1) * ((nx + 1) * (ny + 1)) + i * (ny + 1) + j + 1
        bottom = [d, c, b, a]
        front = [a, b, bb, aa]
        right = [b, c, cc, bb]
        left = [a, aa, dd, d]
        back = [c, d, dd, cc]
        top = [aa, bb, cc, dd]
        cells.append([bottom, front, left, back, right, top])

    return VolMesh.from_vertices_and_cells(vertices, cells)
# ---------- end python ----------
filter = Data(stream_filter)
grid = GhPythonScript(
    from_meshgrid=python,
    nx=number_slider,
    ny=number_slider_3,
    nz=number_slider_2,
    selected_filter=filter,
    xsize=number_slider_4,
    ysize=number_slider_5,
    zsize=number_slider_6,
    main_beam_width=main_beam_width,
    main_beam_height=main_beam_height,
    column_width_x=column_width_x,
    column_depth_y=column_depth_y,
    slab_height=slab_height,
    facade_thickness=facade_thickness)  # -> grid; inputs nx: Int32, ny: Int32, nz: Int32
# ---------- grid: Python ----------
class BuildingGrid(object):
    """Represents a building structure built around a regular grid."""
    def __init__(self, xsize, ysize, zsize, nx, ny, nz, selected_filter, main_beam_width, main_beam_height, column_width_x, column_depth_y, slab_height, facade_thickness):
        self.volmesh = from_meshgrid(selected_filter, xsize, ysize, zsize, nx, ny, nz)
        self.volmesh.cull_vertices()
        self.columns = []
        self.main_beams = []

        self.main_beam_width = main_beam_width
        self.main_beam_height = main_beam_height
        self.column_width_x = column_width_x
        self.column_depth_y = column_depth_y
        self.slab_height = slab_height
        self.facade_thickness = facade_thickness

    # NOTE: We have moved the generate_columns and generate_main_beams methods
    # out from here and into the specific components that generate them

    def number_of_columns(self):
        return len(self.columns)

    def number_of_mainbeams(self):
        return len(self.main_beams)
        
    def number_of_slabs(self):
        return len(self.slabs)

grid = BuildingGrid(xsize, ysize, zsize, nx, ny, nz, selected_filter, main_beam_width, main_beam_height, column_width_x, column_depth_y, slab_height, facade_thickness)
# ---------- end grid ----------

# ----
# Create structure
# If you already solved the "Slabs" exercise, you can paste the slab generation component here to help visualize everything in context.
facade = GhPythonScript(grid=grid)  # -> facade_walls
# ---------- facade: Python ----------
from compas.geometry import Box
from compas.geometry import Frame
from compas.geometry import Vector


# 1. Create a Wall class
# ..
    # 2. Add shape and orientation as parameters of the constructor
    # ..
        # 3. Store them as attributes of the instance
        # ..
        # ..

    # 3. Add an area() method that returns the area of the shape
    # ..


def generate_facades(grid):
    # 4. Reset the list of walls
    # ..

    # 5. For each face in the volmesh
    for hf in grid.volmesh.faces():
        pass

        # 6. Check if it's in on boundary, otherwise continue to the next face
        # ..

        # 7. Get the normal of the face
        # ..

        # 8. Calculate the dot product to the unit vector Z
        # ..
        
        # 9. If the dot product is zero
        # ..
            # 10. Find the centroid and half-edges of the face
            ## ..

            # 11. Get directions of two edges (direction is a unitized vector but is a list of floats, not a Vector class)
            # ..

            # 12. Convert both lists of directions to Vector instances
            # ..

            # 13. Get length of both edges
            # ..

            # 14. Calculate the xaxis and yaxis for the box's frame based on the normal of the face
            # ..

            # 15. Flush the frame to the outer side of the building (optional)
            # ..

            # 16. Choose width/depth based on edge's whether edge is parallel to frame's xaxis
            # ..

            # 17. Construct a box
            # ..
            
            # 18. Create wall instance and append it to grid.walls
            # ..
            
            # 19. Assign wall orientation based on frame's normal
            # ..

# 20. Generate facades
generate_facades(grid)
facade_walls = grid.walls
# ---------- end facade ----------
cells = GhPythonScript(grid=grid)  # -> cells
# ---------- cells: Python ----------
# This component does a custom conversion of the volmesh cell
# into Box BREPs. The current version of compas would generate
# meshes for each box, so for better visualization, we use this
# alternative option to create breps.

import Rhino.Geometry as rg

cells = []

for cell in grid.volmesh.cells():
    vertices = grid.volmesh.cell_vertices(cell)
    vertices_coords = []
    for vertex in vertices:
        vertices_coords.append(grid.volmesh.vertex_coordinates(vertex))

    start = min(vertices_coords)
    end = max(vertices_coords)

    start_point = rg.Point3d(start[0], start[1], start[2])
    end_point = rg.Point3d(end[0], end[1], end[2])

    cell = rg.Box(rg.BoundingBox(start_point, end_point))
    cells.append(cell)
# ---------- end cells ----------
columns = GhPythonScript(grid=grid)  # -> columns
# ---------- columns: Python ----------
# We use this direct conversion instead of the component
# because we want the Box BREP instead of the meshes
from compas_rhino.conversions import box_to_rhino
from compas.geometry import Box
from compas.geometry import Frame
from compas.geometry import Vector


def generate_columns(grid):
    # First reset the list of columns
    grid.columns = []

    # Now generate columns
    for uv in grid.volmesh.edges():

        # If the edge vector is parallel to unit vector Z...
        edge_direction = grid.volmesh.edge_direction(uv)
        edge_vector = Vector(edge_direction[0], edge_direction[1], edge_direction[2])
        if edge_vector.dot(Vector.Zaxis()) in (1, -1):

            # ...we add a column
            edge_point = grid.volmesh.edge_point(uv)
            edge_length = grid.volmesh.edge_length(uv)

            frame = Frame(edge_point, Vector.Xaxis(), Vector.Yaxis())
            column = Box(frame, grid.column_width_x, grid.column_depth_y, edge_length)
            grid.columns.append(column)

# Call the method to generate columns
generate_columns(grid)

# And generate all the geometry (BREPs) for each
columns = []

for column in grid.columns:
    column = box_to_rhino(column)
    columns.append(column)
# ---------- end columns ----------
main_beams = GhPythonScript(grid=grid)  # -> mainbeams
# ---------- main_beams: Python ----------
# We use this direct conversion instead of the component
# because we want the Box BREP instead of the meshes
from compas_rhino.conversions import box_to_rhino
from compas.geometry import Box
from compas.geometry import Frame
from compas.geometry import Line
from compas.geometry import Vector

def generate_main_beams(grid):
    # Reset list of main beams
    grid.main_beams = []
    
    # Generate main beams
    for uv in grid.volmesh.edges():

        # If the edge vector is perpendicular to unit vector Z...
        edge_direction = grid.volmesh.edge_direction(uv)
        edge_vector = Vector(edge_direction[0], edge_direction[1], edge_direction[2])
        if edge_vector.dot(Vector.Zaxis()) == 0:

            # ... we add a main bean 
            start, end = grid.volmesh.edge_coordinates(uv)
            line = Line(start, end)
            
            # Shorten the beam to fit the columns
            if edge_vector.dot(Vector.Xaxis()) in (1, -1):
                shift_value = grid.column_width_x
            else:
                shift_value = grid.column_depth_y

            # Create the box in the origin of world XY frame
            mainbeam = Box.from_width_height_depth(grid.main_beam_width, grid.main_beam_height, line.length - shift_value)
            
            # Create a frame where the beam has to be placed
            frame = Frame(line.midpoint, edge_vector.cross(Vector.Zaxis()), edge_vector)
            frame.point.z -= grid.main_beam_height / 2
    
            # Move box to newly created frame
            mainbeam.frame = frame

            grid.main_beams.append(mainbeam)

# Call the method to gnerate main beams
generate_main_beams(grid)

# And generate all the geometry (BREPs) for each
mainbeams = []

for mainbeam in grid.main_beams:
    b = box_to_rhino(mainbeam)
    mainbeams.append(b)
# ---------- end main_beams ----------

# ---- group: Cells
# Visualization
colour_swatch = ColourSwatch(SwatchColor=RGBA(41, 115, 111, 124))
custom_preview = CustomPreview(Geometry=cells, Material=colour_swatch)

# ---- group: Columns
custom_preview_2 = CustomPreview(Geometry=columns, Material=ColourSwatch(SwatchColor=RGBA(115, 41, 41, 124)))

# ---- group: Main beams
custom_preview_3 = CustomPreview(Geometry=main_beams, Material=ColourSwatch(SwatchColor=RGBA(252, 129, 35, 156)))

# ----
ghpython_script = GhPythonScript(facade_walls=facade)  # -> facades, colors; inputs facade_walls: list
# ---------- ghpython_script: Python ----------
from compas_rhino.conversions import box_to_rhino

# Create two empty lists, one for facades (boxes) and one for colors
# ..
# ---------- end ghpython_script ----------
custom_preview_4 = CustomPreview(Geometry=ghpython_script.facades, Material=ghpython_script.colors)

# ----
# Analysis
facade_area = GhPythonScript(grid=grid)  # -> out
# ---------- facade_area: Python ----------
# Print the total area of the facade per orientation (N/E/S/W)
# ..
# ---------- end facade_area ----------
panel = Panel(facade_area)
