# Grasshopper definition 03-building-grid-design-explorations.gh (Grasshopper 1.0.7)

# ---- group: Grid size
number_slider = Slider(9, range=0..20)
number_slider_2 = Slider(18, range=0..20)
number_slider_3 = Slider(9, range=0..20)

# ---- group: Cell sizes
number_slider_4 = Slider(5, range=0..20)
number_slider_5 = Slider(4.5, range=0..20)
number_slider_6 = Slider(3.5, range=0..20)

# ---- group: Options
main_beam_width = Slider(0.35, range=0.1..0.9)
main_beam_height = Slider(0.4, range=0.1..0.9)
column_width_x = Slider(0.35, range=0.1..0.9)
column_depth_y = Slider(0.45, range=0.1..0.9)
slab_height = Slider(0.2, range=0.1..0.9)
facade_thickness = Slider(0.2, range=0.1..0.9)

# ---- group: Variations on height
ghpython_script = GhPythonScript()  # -> height_variation
# ---------- ghpython_script: Python ----------
def height_variation(level, dz):
    # This function is expected to return the distance in Z for a given level (floor)
    # If we return dz always, all floors will have the same height
    # If we add conditionals here, we can customize
    # some floors to have different heights

    return dz
# ---------- end ghpython_script ----------

# ----
# Applying classes to create buildings
# Filters selection
modulo_filter = GhPythonScript()  # -> mfilter
# ---------- modulo_filter: Python ----------
# Sample filter
class ModuleBasedFilter(object):
    def is_included(self, x, y, z):
        if (x + y) % 2 == 0:
            return True

        return False

mfilter = ModuleBasedFilter()
# ---------- end modulo_filter ----------
random_filter = GhPythonScript()  # -> rfilter
# ---------- random_filter: Python ----------
# Sample filter
from random import choice

class RandomFilter(object):
    def is_included(self, x, y, z):
        return choice([True, False])

rfilter = RandomFilter()
# ---------- end random_filter ----------
linear_filter = GhPythonScript()  # -> lfilter
# ---------- linear_filter: Python ----------
# Sample filter
class LinearFilter(object):
    def __init__(self, coefficient=1, vertical_shift_x=0, vertical_shift_y=0, horizontal_shift_x=0, horizontal_shift_y=0):
        super(LinearFilter, self).__init__()
        self.coefficient = coefficient
        self.vertical_shift_x = vertical_shift_x
        self.vertical_shift_y = vertical_shift_y
        self.horizontal_shift_x = horizontal_shift_x
        self.horizontal_shift_y = horizontal_shift_y

    def is_included(self, x, y, z):
        z_range_x = (self.coefficient * x + self.vertical_shift_x) + self.horizontal_shift_x
        z_range_y = (self.coefficient * y + self.vertical_shift_y) + self.horizontal_shift_y
        return not z_range_x < z > z_range_y

lfilter = LinearFilter(coefficient= 3, vertical_shift_x= -3, vertical_shift_y=-3, horizontal_shift_x=0, horizontal_shift_y=0)
# ---------- end linear_filter ----------
paraboloid_filter = GhPythonScript()  # -> pfilter
# ---------- paraboloid_filter: Python ----------
# Solution of assignment 02: main task
class ParaboloidFilter(object):
    def __init__(self, coefficient=1, shift_x=0, shift_y=0):
        super(ParaboloidFilter, self).__init__()
        self.coefficient = coefficient
        self.shift_x = shift_x
        self.shift_y = shift_y

    def is_included(self, x, y, z):
        return (x - self.shift_x) ** 2 + (y - self.shift_y) ** 2 > self.coefficient * z

pfilter = ParaboloidFilter(coefficient=4, shift_x=0, shift_y=0)
# ---------- end paraboloid_filter ----------
value_list = ValueList({"Modulo filter": 0, "Random filter": 1, "Linear filter": 2, "Paraboloid filter": 3, "Merge filter": 4}, selected="Paraboloid filter")

merge = Merge(Data1=modulo_filter, Data2=paraboloid_filter)
merge_filter = GhPythonScript(sub_filters=merge)  # -> mfilter; inputs sub_filters: list
# ---------- merge_filter: Python ----------
# Solution of assignment 02: challenge 02
class MergeFilter(object):
    def __init__(self, sub_filters):
        self.sub_filters = sub_filters

    def is_included(self, x, y, z):
        for subfilter in self.sub_filters:
            if not subfilter.is_included(x, y, z):
                return False

        return True

mfilter = MergeFilter(sub_filters)
# ---------- end merge_filter ----------

stream_filter = StreamFilter(
    Gate=value_list,
    Stream0=modulo_filter,
    Stream1=random_filter,
    Stream2=linear_filter,
    Stream3=paraboloid_filter,
    Stream4=merge_filter)

# ----
# Create grid based on volumetric mesh
filter = Data(stream_filter)
python = GhPythonScript(height_variation=ghpython_script)  # -> from_meshgrid
# ---------- python: Python ----------
from itertools import product
from compas.datastructures import VolMesh
from compas.utilities import linspace

def create_3d_grid(nx, ny, nz, dx, dy, dz):
    vertices = []
    z = 0
    for k in range(nz + 1):
        x = 0
        for i in range(nx + 1):
            y = 0
            for j in range(ny + 1):
                vertices.append((x, y, z))
                y += dy
            x += dx

        z += height_variation(k, dz)
    return vertices
    
def from_meshgrid(selected_filter, dx, dy, dz, nx, ny, nz):
    vertices = []
    vertices = create_3d_grid(nx, ny, nz, dx, dy, dz)

    cells = []
    cells_attrs = []
    for k, i, j in product(range(nz), range(nx), range(ny)):
        if not selected_filter.is_included(j, i, k):
            continue

        attributes = {"i": i, "j": j, "k": k}
        cells_attrs.append(attributes)

        a = k * ((nx + 1) * (ny + 1)) + i * (ny + 1) + j
        b = k * ((nx + 1) * (ny + 1)) + (i + 1) * (ny + 1) + j
        c = k * ((nx + 1) * (ny + 1)) + (i + 1) * (ny + 1) + j + 1
        d = k * ((nx + 1) * (ny + 1)) + i * (ny + 1) + j + 1
        aa = (k + 1) * ((nx + 1) * (ny + 1)) + i * (ny + 1) + j
        bb = (k + 1) * ((nx + 1) * (ny + 1)) + (i + 1) * (ny + 1) + j
        cc = (k + 1) * ((nx + 1) * (ny + 1)) + (i + 1) * (ny + 1) + j + 1
        dd = (k + 1) * ((nx + 1) * (ny + 1)) + i * (ny + 1) + j + 1
        bottom = [d, c, b, a]
        front = [a, b, bb, aa]
        right = [b, c, cc, bb]
        left = [a, aa, dd, d]
        back = [c, d, dd, cc]
        top = [aa, bb, cc, dd]
        cells.append([bottom, front, left, back, right, top])

    volmesh = VolMesh.from_vertices_and_cells(vertices, cells)
    for cell, cell_attr in zip(volmesh.cells(), cells_attrs):
        volmesh.cell_attributes(cell, cell_attr.keys(), cell_attr.values())

    return volmesh
# ---------- end python ----------
grid = GhPythonScript(
    from_meshgrid=python,
    nx=number_slider,
    ny=number_slider_3,
    nz=number_slider_2,
    selected_filter=filter,
    xsize=number_slider_4,
    ysize=number_slider_5,
    zsize=number_slider_6,
    main_beam_width=main_beam_width,
    main_beam_height=main_beam_height,
    column_width_x=column_width_x,
    column_depth_y=column_depth_y,
    slab_height=slab_height,
    facade_thickness=facade_thickness)  # -> grid; inputs nx: Int32, ny: Int32, nz: Int32
# ---------- grid: Python ----------
class BuildingGrid(object):
    """Represents a building structure built around a regular grid."""
    def __init__(self, xsize, ysize, zsize, nx, ny, nz, selected_filter, main_beam_width, main_beam_height, column_width_x, column_depth_y, slab_height, facade_thickness):
        self.volmesh = from_meshgrid(selected_filter, xsize, ysize, zsize, nx, ny, nz)
        self.volmesh.cull_vertices()
        self.columns = []
        self.main_beams = []

        self.main_beam_width = main_beam_width
        self.main_beam_height = main_beam_height
        self.column_width_x = column_width_x
        self.column_depth_y = column_depth_y
        self.slab_height = slab_height
        self.facade_thickness = facade_thickness

    # NOTE: We have moved the generate_columns and generate_main_beams methods
    # out from here and into the specific components that generate them

    def number_of_columns(self):
        return len(self.columns)

    def number_of_mainbeams(self):
        return len(self.main_beams)
        
    def number_of_slabs(self):
        return len(self.slabs)

grid = BuildingGrid(xsize, ysize, zsize, nx, ny, nz, selected_filter, main_beam_width, main_beam_height, column_width_x, column_depth_y, slab_height, facade_thickness)
# ---------- end grid ----------

# ----
# Create structure
cells = GhPythonScript(grid=grid)  # -> cells
# ---------- cells: Python ----------
# This component does a custom conversion of the volmesh cell
# into Box BREPs. The current version of compas would generate
# meshes for each box, so for better visualization, we use this
# alternative option to create breps.

import Rhino.Geometry as rg

cells = []

for cell in grid.volmesh.cells():
    vertices = grid.volmesh.cell_vertices(cell)
    vertices_coords = []
    for vertex in vertices:
        vertices_coords.append(grid.volmesh.vertex_coordinates(vertex))

    start = min(vertices_coords)
    end = max(vertices_coords)

    start_point = rg.Point3d(start[0], start[1], start[2])
    end_point = rg.Point3d(end[0], end[1], end[2])

    cell = rg.Box(rg.BoundingBox(start_point, end_point))
    cells.append(cell)
# ---------- end cells ----------
columns = GhPythonScript(grid=grid)  # -> columns
# ---------- columns: Python ----------
# We use this direct conversion instead of the component
# because we want the Box BREP instead of the meshes
from compas_rhino.conversions import box_to_rhino
from compas.geometry import Box
from compas.geometry import Frame
from compas.geometry import Vector


def generate_columns(grid):
    # First reset the list of columns
    grid.columns = []

    # Now generate columns
    for uv in grid.volmesh.edges():

        # If the edge vector is parallel to unit vector Z...
        edge_direction = grid.volmesh.edge_direction(uv)
        edge_vector = Vector(edge_direction[0], edge_direction[1], edge_direction[2])
        if edge_vector.dot(Vector.Zaxis()) in (1, -1):

            # ...we add a column
            edge_point = grid.volmesh.edge_point(uv)
            edge_length = grid.volmesh.edge_length(uv)

            frame = Frame(edge_point, Vector.Xaxis(), Vector.Yaxis())
            column = Box(frame, grid.column_width_x, grid.column_depth_y, edge_length)
            grid.columns.append(column)

# Call the method to generate columns
generate_columns(grid)

# And generate all the geometry (BREPs) for each
columns = []

for column in grid.columns:
    column = box_to_rhino(column)
    columns.append(column)
# ---------- end columns ----------
main_beams = GhPythonScript(grid=grid)  # -> mainbeams
# ---------- main_beams: Python ----------
# We use this direct conversion instead of the component
# because we want the Box BREP instead of the meshes
from compas_rhino.conversions import box_to_rhino
from compas.geometry import Box
from compas.geometry import Frame
from compas.geometry import Line
from compas.geometry import Vector

def generate_main_beams(grid):
    # Reset list of main beams
    grid.main_beams = []
    
    # Generate main beams
    for uv in grid.volmesh.edges():

        # If the edge vector is perpendicular to unit vector Z...
        edge_direction = grid.volmesh.edge_direction(uv)
        edge_vector = Vector(edge_direction[0], edge_direction[1], edge_direction[2])
        if edge_vector.dot(Vector.Zaxis()) == 0:

            # ... we add a main bean 
            start, end = grid.volmesh.edge_coordinates(uv)
            line = Line(start, end)
            
            # Shorten the beam to fit the columns
            if edge_vector.dot(Vector.Xaxis()) in (1, -1):
                shift_value = grid.column_width_x
            else:
                shift_value = grid.column_depth_y

            # Create the box in the origin of world XY frame
            mainbeam = Box.from_width_height_depth(grid.main_beam_width, grid.main_beam_height, line.length - shift_value)
            
            # Create a frame where the beam has to be placed
            frame = Frame(line.midpoint, edge_vector.cross(Vector.Zaxis()), edge_vector)
            frame.point.z -= grid.main_beam_height / 2
    
            # Move box to newly created frame
            mainbeam.frame = frame

            grid.main_beams.append(mainbeam)

# Call the method to gnerate main beams
generate_main_beams(grid)

# And generate all the geometry (BREPs) for each
mainbeams = []

for mainbeam in grid.main_beams:
    b = box_to_rhino(mainbeam)
    mainbeams.append(b)
# ---------- end main_beams ----------
facade = GhPythonScript(grid=grid)  # -> facade_walls
# ---------- facade: Python ----------
from compas.geometry import Box
from compas.geometry import Frame
from compas.geometry import Vector


# 1. Create a Wall class
class Wall(object):
    # 2. Add shape and orientation as parameters of the constructor
    def __init__(self, shape, orientation=None):
        # 3. Store them as attributes of the instance
        self.shape = shape
        self.orientation = orientation

    # 3. Add an area method that returns the area of the shape
    def area(self):
        return self.shape.xsize * self.shape.ysize


def generate_facades(grid):
    # 4. Reset the list of walls
    grid.walls = []

    # 5. For each face in the volmesh
    for hf in grid.volmesh.faces():

        # 6. Check if it's in on boundary, otherwise continue to the next face
        if not grid.volmesh.is_halfface_on_boundary(hf):
            continue

        # 7. Get the normal of the face
        hf_normal = grid.volmesh.face_normal(hf)
        hf_vector = Vector(hf_normal[0], hf_normal[1], hf_normal[2])

        # 8. Calculate the dot product to the unit vector Z
        dot_product_z_axis = hf_vector.dot(Vector.Zaxis())
        
        # 9. If the dot product is zero
        if dot_product_z_axis == 0:
            # 10. Find the centroid and half-edges of the face
            centroid = grid.volmesh.halfface_centroid(hf)
            hf_edges = grid.volmesh.halfface_halfedges(hf)

            # 11. Get directions of two edges (direction is a unitized vector but is a list of floats, not a Vector class)
            edge_0_direction = grid.volmesh.edge_direction(hf_edges[0])
            edge_1_direction = grid.volmesh.edge_direction(hf_edges[1])
            
            # 12. Convert both lists of directions to Vector instances
            edge_0_vector = Vector(edge_0_direction[0], edge_0_direction[1], edge_0_direction[1])
            edge_1_vector = Vector(edge_1_direction[0], edge_1_direction[1], edge_1_direction[1])

            # 13. Get length of both edges
            edge_0 = grid.volmesh.edge_length(hf_edges[0])
            edge_1 = grid.volmesh.edge_length(hf_edges[1])

            # 14. Calculate the xaxis and yaxis for the box's frame based on the normal of the face
            xaxis = hf_vector.cross(Vector.Zaxis())
            yaxis = hf_vector.cross(xaxis)
            frame = Frame(centroid, xaxis, yaxis)

            # 15. Choose width/depth based on edge's whether edge is parallel to frame's xaxis
            # .. also adjust the facade to fit better within the available space
            # .. (subtract the beams and columns and adjust the centroid)
            if frame.xaxis.dot(edge_0_vector) == 0:
                width, depth = edge_1, edge_0
                width -= grid.column_depth_y
            else:
                depth, width = edge_1, edge_0
                width -= grid.column_width_x
            frame.point.z -= grid.main_beam_height / 2 -grid.slab_height / 2
            depth -= grid.main_beam_height + grid.slab_height

            # 16. Construct a box
            box = Box.from_width_height_depth(width, grid.facade_thickness, depth)
            box.frame = frame
            
            # 17. Append box to list
            wall = Wall(box)
            grid.walls.append(wall)
            
            # 18. Assign wall orientation based on frame's normal
            if frame.normal.dot(Vector.Yaxis()) == 1:
                wall.orientation = "S"
            elif frame.normal.dot(Vector.Yaxis()) == -1:
                wall.orientation = "N"
            elif frame.normal.dot(Vector.Xaxis()) == 1:
                wall.orientation = "W"
            elif frame.normal.dot(Vector.Xaxis()) == -1:
                wall.orientation = "E"

# 19. Generate facades
generate_facades(grid)
facade_walls = grid.walls
# ---------- end facade ----------

slabs = GhPythonScript(grid=grid)  # -> slabs
# ---------- slabs: Python ----------
"""
## Main task

Goal: Create slabs for our building grid.

A slab is represented visually as a box (using compas.geometry.Box).
The basic idea is to rely on the volmesh to know where to add each slab.
We will create one slab per each face of our grid's volmesh if the face is 
aligned to the XY plane (ie. flat).

We will create a Slab class that will contain the attributes and methods of each slab.
The Slab class needs two attributes: shape (a box), and function (a string).
Function will only be used if you tackle challenge 01. Otherwise you can ignore it.

#### Details

The algorithm that we need to implement, as well as hints to functions you might need,
is in code comments, as a step-by-step guide.

---------------------------------------------------------------------------------------

## Challenge 01

Goal: Assign the function of each slab

Each slab can be assigned one of three different functions: "roof", "floor_slab" or "bottom_slab". 

#### Details

The algorithm that we need to implement, as well as hints to functions you might need,
is in code comments, as a step-by-step guide.

"""
from compas_rhino.conversions import box_to_rhino
from compas.geometry import Box
from compas.geometry import Point
from compas.geometry import Vector

# START OF MAIN TASK
# 1. Create a class Slab with two parameters in the its __init__: shape and function
class Slab(object):
    def __init__(self, shape, function=None):
        self.shape = shape
        self.function = function
    
    def calculate_volume(self):
        return self.shape.volume

# 2. Create a generate_slabs method that takes the grid as parameter
#    and appends slabs to its grid.slabs attribute
def generate_slabs(grid):
    # Reset slabs list to an empty list
    grid.slabs = []

    # Iterate: for each face in the volmesh (hint: faces() of volmesh)
    for hf in grid.volmesh.faces():

        # Get the normal of the half-face (hint: face_normal() of volmesh)
        hf_normal = grid.volmesh.face_normal(hf)
        hf_vector = Vector(hf_normal[0], hf_normal[1], hf_normal[2])

        # if it's parallel to the unit Z axis, we will add a slab
        dot_product_z_axis = hf_vector.dot(Vector.Zaxis())
        if abs(dot_product_z_axis) == 1:
            
            # To add a slab:
            # 1. find the centroid of the half-face (hint: halfface_centroid() of volmesh)
            centroid = grid.volmesh.halfface_centroid(hf)
            # 2. Take the first two edges of the half-face (hint: halfface_halfedges() of volmesh)
            hf_edges = grid.volmesh.halfface_halfedges(hf)
            
            # 3. And calculate width and depth of the slab from their lengths (hint: edge_length() of volmesh)
            width = grid.volmesh.edge_length(hf_edges[0])
            depth = grid.volmesh.edge_length(hf_edges[1])

            # 4. Create a box with those values + the slab_height attribute of the grid 
            #    (hint: use Box constructor taking width, height and depth parameters)
            box = Box.from_width_height_depth(width, grid.slab_height, depth)

            # 5. The box was created at (0,0,0), move it to the correct point
            box.frame.point = centroid
            box.frame.point.z += grid.slab_height / 2
            
            # 6. Create an instance of the slab class you created above
            slab = Slab(box)

            # 7. Append it to the grid.slabs attribute list
            grid.slabs.append(slab)

            # END OF MAIN TASK

            # START OF CHALLENGE 01

            # Detect if there's a cell opposite to the half-face we're in (hint: halfface_opposite_cell() of volmesh)
            opposite_cell = grid.volmesh.halfface_opposite_cell(hf)

            # If there's an opposite cell, it's a floor_slab function
            # if not, and the dot product to the z axis is positive, it's a roof (ie. there are no cells above it).
            # if not, and the dot product to the z axis is negative, it's a bottom_slab (ie. there are no cells below it).
            if opposite_cell:
                slab.function = "floor_slab"
            elif dot_product_z_axis > 0:
                slab.function = "roof"
            elif dot_product_z_axis < 0:
                slab.function = "bottom_slab"
            # END OF CHALLENGE 01


# Call the method to gnerate slabs
generate_slabs(grid)

# And assign the grid.slabs attribute to the correct output attribute
slabs = grid.slabs
# ---------- end slabs ----------
slabs_2 = GhPythonScript(slabs=slabs)  # -> floor_slabs, roofs, bottom_slabs; inputs slabs: list
# ---------- slabs_2: Python ----------
# Notes: this code will iterate over all slabs
# and separate them into different lists based on their function
from compas_rhino.conversions import box_to_rhino

roofs = []
floor_slabs = []
bottom_slabs = []

for slab in slabs:
    b = box_to_rhino(slab.shape)
    if slab.function == "roof":
        roofs.append(b)
    elif slab.function == "bottom_slab":
        bottom_slabs.append(b)
    else:
        floor_slabs.append(b)
# ---------- end slabs_2 ----------

# ---- group: Cells
# Visualization
colour_swatch = ColourSwatch(SwatchColor=RGBA(41, 115, 111, 124))
custom_preview = CustomPreview(Geometry=cells, Material=colour_swatch)

# ---- group: Columns
custom_preview_2 = CustomPreview(Geometry=columns, Material=ColourSwatch(SwatchColor=RGBA(10, 10, 10, 124)))

# ---- group: Main beams
custom_preview_3 = CustomPreview(Geometry=main_beams, Material=ColourSwatch(SwatchColor=RGBA(0, 0, 0, 156)))

# ---- group: Slab
custom_preview_4 = CustomPreview(Geometry=slabs_2.floor_slabs, Material=ColourSwatch(SwatchColor=RGBA(0, 0, 0, 104)))
custom_preview_5 = CustomPreview(Geometry=slabs_2.roofs, Material=ColourSwatch(SwatchColor=RGBA(0, 0, 0, 104)))
custom_preview_6 = CustomPreview(Geometry=slabs_2.bottom_slabs, Material=ColourSwatch(SwatchColor=RGBA(143, 159, 176, 131)))

# ---- group: Facade walls
attractor_curve = Curve()
ghpython_script_2 = GhPythonScript(facade_walls=facade, curve=attractor_curve)  # -> facades, distances; inputs facade_walls: list, curve: Curve
# ---------- ghpython_script_2: Python ----------
import math
from compas_rhino.conversions import box_to_rhino
from compas_rhino.conversions import RhinoCurve
from compas.geometry import distance_point_point
from compas.geometry import Rotation

# Reference the curve from Rhino/Grasshopper and convert to COMPAS
# ..

# Create an empty list for facades (boxes)
# ..

# For each facade wall
# ..
    # Let's create an alias to the frame of the wall's shape (box)
    # .. because we are lazy to type too much ;)
    # ..

    # Calculate the closest point on curve from the centroid of the box (hint: .closest_point() of Curve)
    # ..
    
    # Calculate distance to the centroid of the box (hint: .distance_to_point() of Point)
    # ..

    # Copy the shape (box)
    # WHY? Because we will rotate it. If we don't copy, the next time we run this script,
    # .. it will rotate again over the previous rotation!
    # ..
   
    # Let's make only the South facade be modified by the attractor
    # ..
        # Calculate some rotation value
        # You can play around with how to calculate a value that produces nice results
        # ..
        
        # Create a Rotation object from axis and angle values.
        # The axis coud be X or Y axis of the box's frame, the angle value is what we calculated above
        # We also need to rotate around the centroid of the box (otherwise it rotates around 0, 0, 0)
        # ..

        # Finally, we transform the box frame with our rotation and re-assign it
        # ..

    # Append the shape to converted to a rhino box
    # ..
# ---------- end ghpython_script_2 ----------
custom_preview_7 = CustomPreview(Geometry=ghpython_script_2.facades, Material=ColourSwatch(SwatchColor=RGBA(255, 255, 255, 146)))

# ---- group: Attractor-based coloring
bounds = Bounds(Numbers=ghpython_script_2.distances)  # disabled
deconstruct_domain = DeconstructDomain(Domain=bounds)  # -> Start, End; disabled
gradient = Gradient(
    LowerLimit=deconstruct_domain.Start,
    UpperLimit=deconstruct_domain.End,
    Parameter=ghpython_script_2.distances,
    stops=[0.103: RGB(50, 50, 50), 0.628: RGB(190, 190, 190)])  # disabled
custom_preview_8 = CustomPreview(Geometry=ghpython_script_2.facades, Material=gradient)  # disabled
