# Grasshopper definition 01-lists-and-loops_hs24.gh (Grasshopper 1.0.7)

# ----
# For loops
# Import Point class from library
python = GhPythonScript()  # -> out, a
# ---------- python: Python ----------
from compas.geometry import Point

a = Point(1, 0, 0)
# ---------- end python ----------
draw = Draw(cg=python.a)  # -> rg
#   port cg: The COMPAS geometry or datastructure to be drawn.
# ---------- draw: Python ----------
from compas_rhino.conversions import point_to_rhino

rg = point_to_rhino(cg)
# ---------- end draw ----------

# ----
# Construct Point
pt = ConstructPoint(XCoordinate=0, YCoordinate=1, ZCoordinate=0)
panel = Panel(pt)

# ----
# Grasshopper
# Point Container
pt_2 = Point(Point(0, 0, 2))
panel_2 = Panel(pt_2)

# ---- group: These examples show additional ways to achieve the same and some other additional features
# extra mile examples
# product(), range(), append()
number_slider = Slider(8, range=0..10)
python_2 = GhPythonScript(num_x=number_slider, num_y=Slider(8, range=0..10))  # -> out, points; inputs num_x: Int32, num_y: Int32
# ---------- python_2: Python ----------
from compas.geometry import Point
from itertools import product

def create_point_grid(nx, ny):
    points = []
    for x, y in product(range(nx), range(ny)):
        points.append(Point(x, y, 0))

    return points

points = create_point_grid(num_x, num_y)
print(points)
# ---------- end python_2 ----------
draw_2 = Draw(cg=python_2.points)  # -> rg; same code as draw
dots = DotDisplay(Point=draw_2, Colour=RGB(255, 0, 0), Size=0.1)
text_tag_xy = TextTagXY(list=draw_2, y_position=0.25, text_size=0.15)

# nested loop, range(), if, continue, append()
number_slider_2 = Slider(7, range=0..10)
python_3 = GhPythonScript(num_x=Slider(8, range=0..10), num_y=number_slider_2)  # -> out, points; inputs num_x: Int32, num_y: Int32
# ---------- python_3: Python ----------
from compas.geometry import Point

def create_point_grid(nx, ny):
    points = []
    for x in range(nx):
        for y in range(ny):
            point = Point(x, y, 0)
            if y % 2 == 0 and x % 3 == 0:
                continue
            points.append(point)

    return points

points = create_point_grid(num_x, num_y)
print(points)
# ---------- end python_3 ----------

# product(), range(), count, if, break, append()
max = Slider(10, range=0..16)
python_4 = GhPythonScript(max_points=max)  # -> out, points
# ---------- python_4: Python ----------
from compas.geometry import Point
from itertools import product

def create_point_grid(nx, ny, max_points):
    points = []

    for x, y in product(range(nx), range(ny)):
        point = Point(x, y, 0)
        points.append(point)
        if len(points) >= max_points:
            break

    return points

width, depth = 4, 4
points = create_point_grid(width, depth, max_points)
print(points)
# ---------- end python_4 ----------

# ----
# Series of points (Series)
number_slider_3 = Slider(0, range=0..10)
series = Series(Start=number_slider_3, Step=Slider(1, range=0..10), Count=Slider(5, range=0..10))
pt_3 = ConstructPoint(XCoordinate=series, YCoordinate=0, ZCoordinate=0)

series_2 = Series(Start=Slider(0, range=0..10), Step=Slider(1, range=0..10), Count=Slider(5, range=0..10))
series_3 = Series(Start=Slider(0, range=0..10), Step=Slider(1, range=0..10), Count=Slider(5, range=0..10))
pt_4 = ConstructPoint(XCoordinate=series_2, YCoordinate=series_3, ZCoordinate=0)

# ---- group: These examples show additional ways to achieve the same and some other additional features
draw_3 = Draw(cg=python_3.points)  # -> rg; same code as draw
dots_2 = DotDisplay(Point=draw_3, Colour=RGB(255, 0, 0), Size=0.1)
text_tag_xy_2 = TextTagXY(list=draw_3, y_position=0.25, text_size=0.15)

draw_4 = Draw(cg=python_4.points)  # -> rg; same code as draw
dots_3 = DotDisplay(Point=draw_4, Colour=RGB(255, 0, 0), Size=0.1)
text_tag_xy_3 = TextTagXY(list=draw_4, y_position=0.25, text_size=0.15)

# ----
range = Range(Domain=Slider(10, range=0..10), Steps=Slider(10, range=0..10))
range_2 = Range(Domain=Slider(10, range=0..10), Steps=Slider(10, range=0..10))
pt_5 = ConstructPoint(XCoordinate=range, YCoordinate=range_2, ZCoordinate=0)

# ----
# Series of points (Range)
number_slider_4 = Slider(10, range=0..10)
range_3 = Range(Domain=number_slider_4, Steps=Slider(5, range=0..10))
pt_6 = ConstructPoint(XCoordinate=0, YCoordinate=range_3, ZCoordinate=0)

# ----
# 3D grid
number_slider_5 = Slider(4, range=0..10)
height = Slider(4, range=0..10)

# ---- group: These examples show additional ways to achieve the same and some other additional features
number_slider_6 = Slider(4, range=0..10)
height_2 = Slider(4, range=0..10)
number_slider_7 = Slider(4, range=0..10)

# ----
# 2D Point Grid
number_slider_8 = Slider(1, range=0..10)
# CrossReference
number_slider_9 = Slider(0, range=0..10)
series_4 = Series(Start=number_slider_9, Step=number_slider_8, Count=Slider(5, range=0..10))
crossref = CrossReference(ListA=series_4, ListB=series_4, CrossMode=1)  # -> ListA, ListB
pt_7 = ConstructPoint(XCoordinate=crossref.ListA, YCoordinate=crossref.ListB, ZCoordinate=0)

# ----
# 3D Point Grid
number_slider_10 = Slider(0, range=0..10)
series_5 = Series(Start=number_slider_10, Step=Slider(1, range=0..10), Count=Slider(5, range=0..10))
series_6 = Series(Start=Slider(0, range=0..10), Step=Slider(1, range=0..10), Count=Slider(5, range=0..10))
crossref_2 = CrossReference(ListA=series_5, ListB=series_5, CrossMode=1)  # -> ListA, ListB
pt_8 = ConstructPoint(XCoordinate=crossref_2.ListA, YCoordinate=crossref_2.ListB, ZCoordinate=graft(series_6))

panel_3 = Panel(pt_7)

# ----
# 3D grid Boxes
number_slider_11 = Slider(4, range=0..10)
height_3 = Slider(4, range=0..10)

# ----
# Points
# simple for loop, range(), if, else
python_5 = GhPythonScript()  # -> out, points; inputs x: Int32, y: Int32
# ---------- python_5: Python ----------
from compas.geometry import Point

points = []

for x in range(10):
    if x % 2 == 0:
        p = Point(x, 0, 0)
    else:
        p = Point(x, 0, 2)

    points.append(p)
# ---------- end python_5 ----------

draw_5 = Draw(cg=python_5.points)  # -> rg; same code as draw

dots_4 = DotDisplay(Point=draw_5, Colour=RGB(255, 0, 0), Size=0.05)
text_tag_xz = TextTagXZ(list=draw_5, z_position=0.1, text_size=0.072)

# ----
# 2D point grid
# nested for loop, range(), append()
number_slider_12 = Slider(8, range=0..10)
python_6 = GhPythonScript(num_x=number_slider_12, num_y=Slider(8, range=0..10))  # -> out, points; inputs num_x: Int32, num_y: Int32
# ---------- python_6: Python ----------
from compas.geometry import Point

def create_point_grid(nx, ny):
    points = []
    for x in range(nx):
        for y in range(ny):
            point = Point(x, y, 0)
            points.append(point)
            
    return points

points = create_point_grid(num_x, num_y)
print(points)
# ---------- end python_6 ----------

draw_6 = Draw(cg=python_6.points)  # -> rg; same code as draw

dots_5 = DotDisplay(Point=draw_6, Colour=RGB(255, 0, 0), Size=0.1)
text_tag_xy_4 = TextTagXY(list=draw_6, y_position=0.25, text_size=0.15)

# ---- group: These examples show additional ways to achieve the same and some other additional features
# nested for loop, range(), if, else, append()
number_slider_13 = Slider(8, range=0..10)
python_7 = GhPythonScript(num_x=number_slider_13, num_y=Slider(8, range=0..10))  # -> out, points_01, points_02; inputs num_x: Int32, num_y: Int32
# ---------- python_7: Python ----------
from compas.geometry import Point

def create_point_grid(nx, ny):
    points_01 = []
    points_02 = []
    for x in range(nx):
        for y in range(ny):
            point = Point(x, y, 0)
            if y % 2 == 0 and x % 3 == 0:
                points_01.append(point)
            else:
                points_02.append(point)
            
    return points_01, points_02

points_01, points_02 = create_point_grid(num_x, num_y)
print(points_01)
print(points_02)
# ---------- end python_7 ----------

draw_7 = Draw(cg=python_7.points_01)  # -> rg; same code as draw
draw_8 = Draw(cg=python_7.points_02)  # -> rg; same code as draw
text_tag_xy_5 = TextTagXY(list=draw_7, y_position=0.25, text_size=0.15)

dots_6 = DotDisplay(Point=draw_7, Colour=RGB(255, 0, 0), Size=0.1)
dots_7 = DotDisplay(Point=draw_8, Colour=RGB(0, 8, 255), Size=0.1)

# nested for loop, range(), count, if, break, append()
max_2 = Slider(64, range=0..64)
python_8 = GhPythonScript(max_points=max_2)  # -> out, points
# ---------- python_8: Python ----------
from compas.geometry import Point

def create_point_grid(nx, ny, nz, max_points):
    points = []
    for x in range(nx):
        for y in range(ny):
            for z in range(nz):
                point = Point(x, y, z)
                points.append(point)
                if len(points) >= max_points:
                    break
            if len(points) >= max_points:
                break
        if len(points) >= max_points:
            break

    return points

width, depth, height = 4, 4, 4
points = create_point_grid(width, depth, height, max_points)
print(points)
# ---------- end python_8 ----------

# ----
draw_9 = Draw(cg=python_8.points)  # -> rg; same code as draw

# ---- group: These examples show additional ways to achieve the same and some other additional features (continued)
dots_8 = DotDisplay(Point=draw_9, Colour=RGB(255, 0, 0), Size=0.05)
text_tag_xz_2 = TextTagXZ(list=draw_9, z_position=0.1, text_size=0.072)

# ----
# nested for loop, range(), append()
python_9 = GhPythonScript(width=number_slider_5, depth=Slider(4, range=0..10), height=height)  # -> out, points; inputs width: Int32, depth: Int32, height: Int32
# ---------- python_9: Python ----------
from compas.geometry import Point

def create_point_grid(nx, ny, nz):
    points = []
    for x in range(nx):
        for y in range(ny):
            for z in range(nz):
                point = Point(x, y, z)
                points.append(point)

    return points

points = create_point_grid(width, depth, height)
print(points)
# ---------- end python_9 ----------

draw_10 = Draw(cg=python_9.points)  # -> rg; same code as draw
dots_9 = DotDisplay(Point=draw_10, Colour=RGB(255, 0, 0), Size=0.05)

text_tag_xz_3 = TextTagXZ(list=draw_10, z_position=0.1, text_size=0.072)

# ---- group: These examples show additional ways to achieve the same and some other additional features
# product(), range(), append()
python_10 = GhPythonScript(width=number_slider_6, depth=number_slider_7, height=height_2)  # -> out, points; inputs width: Int32, depth: Int32, height: Int32
# ---------- python_10: Python ----------
from compas.geometry import Point
from itertools import product

def create_point_grid(nx, ny, nz):
    points = []
    for x, y, z in product(range(nx), range(ny), range(nz)):
        point = Point(x, y, z)
        points.append(point)

    return points

points = create_point_grid(width, depth, height)
print(points)
# ---------- end python_10 ----------

# ----
draw_11 = Draw(cg=python_10.points)  # -> rg; same code as draw

# ---- group: These examples show additional ways to achieve the same and some other additional features
# extra mile examples
dots_10 = DotDisplay(Point=draw_11, Colour=RGB(255, 0, 0), Size=0.05)

text_tag_xz_4 = TextTagXZ(list=draw_11, z_position=0.1, text_size=0.072)

# ----
# product(), Box(), range(), append()
python_11 = GhPythonScript(width=number_slider_11, depth=Slider(4, range=0..10), height=height_3)  # -> out, boxes; inputs width: Int32, depth: Int32, height: Int32
# ---------- python_11: Python ----------
from compas.geometry import Box
from compas.geometry import Frame
from compas.geometry import Point
from itertools import product

def create_point_grid(nx, ny, nz):
    boxes = []

    for x, y, z in product(range(nx), range(ny), range(nz)):
        point = Point(x, y, z)
        frame = Frame(point, [1, 0, 0], [0, 1, 0])
        box = Box(0.2, 0.2, 0.2, frame)
        boxes.append(box)
    
    return boxes

boxes = create_point_grid(width, depth, height)
# ---------- end python_11 ----------

draw_12 = Draw(cg=python_11.boxes)  # -> rg
#   port cg: The COMPAS geometry or datastructure to be drawn.
# ---------- draw_12: Python ----------
from compas_rhino.conversions import box_to_rhino

rg = box_to_rhino(cg)
# ---------- end draw_12 ----------

text_tag_xz_5 = TextTagXZ(list=draw_12, z_position=0.1, text_size=0.072)

# ==== cluster TextTagXZ
list = ClusterInput()
z_position = ClusterInput()
text_size = ClusterInput()
Z = UnitZ(Factor=z_position)
move = Move(Geometry=list, Motion=Z)  # -> Geometry, Transform
xz = XZPlane(Origin=move.Geometry)
tag = TextTag3D(Location=xz, Text=list, Size=text_size, Justification=8)

# ==== cluster TextTagXY
y_position = ClusterInput()
text_size = ClusterInput()
list = ClusterInput()
Y = UnitY(Factor=y_position)
move = Move(Geometry=list, Motion=Y)  # -> Geometry, Transform
tag = TextTag3D(Location=move.Geometry, Text=list, Size=text_size, Justification=8)
