# Grasshopper definition 03-strings_hs24.gh (Grasshopper 1.0.7)

# ----
# Data Types - Strings - “The Zen of Python”
# Load text
ghpython_script = GhPythonScript()  # -> out
# ---------- ghpython_script: Python ----------
# Python import optimizes things so that calling
# import of the same thing twice does not do the same 
# loading two times
# But in this case, we want to force this to ALWAYS
# do the full loading when it imports, otherwise
# the "easter egg" is not printed
# For that, we use a function of compas that will 
# unload the module so that the last line will re-import it.
from compas_rhino import unload_modules
unload_modules('this')

import this
# ---------- end ghpython_script ----------

# ----
# str(), len(), split(), splitlines(), print
python = GhPythonScript(text=ghpython_script)  # -> text, length, lines, words
# ---------- python: Python ----------
length_text = len(text)
length = str(length_text)  + " characters"

words = text.split()
lines = text.splitlines()

print(words)
# ---------- end python ----------

# ----
# 1
# list access
# tree index
# O”
# “H
# E
# L
# L
# 0
# 0
# 0
# O
# “W
# R
# L
# D”
# 0
panel = Panel("""HELLO
WORLD""")
graft = GraftTree(Tree=panel, IncludeEmptyLists=True, IncludeNullItems=True)
panel_2 = Panel(graft)
python_2 = GhPythonScript(text=panel_2)  # -> out, index; inputs text: list
# ---------- python_2: Python ----------
print(text[0])
index = text[0]
# ---------- end python_2 ----------
index_0 = Panel(python_2.index)

# ----
# indexing, access type
# item access
# O”
# “H
# E
# L
# L
# 0
# list index
# 0
# 3
# 1
# 2
# 4
# O
# “W
# R
# L
# D”
# 1
# 0
# 3
# 1
# 2
panel_3 = Panel("""HELLO
WORLD""")
python_3 = GhPythonScript(text=panel_3)  # -> out, index
# ---------- python_3: Python ----------
index = text[0]
print(index)
# ---------- end python_3 ----------
index_0_2 = Panel(python_3.index)

# ----
# 4
# list access
# O”
# “H
# E
# L
# L
# list index
# 0
# 0
# 1
# O
# “W
# R
# L
# D”
panel_4 = Panel("""HELLO
WORLD""")
python_4 = GhPythonScript(text=panel_4)  # -> out, index; inputs text: list; same code as python_2
index_0_3 = Panel(python_4.index)

# ----
# panel, display
the_zen_of_python = Panel(python.text)
number_of_characters = Panel(python.length)
lines = Panel(python.lines)
words = Panel(python.words)

# ----
# upper(), lower(), index access []
# List Access
words_2 = Text(words)
index = Slider(0, range=0..136)
python_5 = GhPythonScript(words=words_2, index=index)  # -> word, word_lower, word_upper; inputs words: list, index: Int32
# ---------- python_5: Python ----------
word = words[index]
word_lower = word.lower()
word_upper = word.upper()
# ---------- end python_5 ----------
panel_5 = Panel(python_5.word)
panel_6 = Panel(python_5.word_lower)
panel_7 = Panel(python_5.word_upper)

# ----
# len()
lines_2 = Text(lines)
python_6 = GhPythonScript(lines=lines_2)  # -> out, length; inputs lines: list
# ---------- python_6: Python ----------
length = len(lines)
# ---------- end python_6 ----------
number_of_words = Panel(python_6.length)

# ----
# list slicing
lines_3 = Text(lines)

# ---- group: Select lines from 3 to 5 (excluded)
python_7 = GhPythonScript(lines=lines_3)  # -> result; inputs lines: list
# ---------- python_7: Python ----------
result = lines[3:5]
# ---------- end python_7 ----------
panel_8 = Panel(python_7)

# ---- group: Select every second line
python_8 = GhPythonScript(lines=lines_3)  # -> result; inputs lines: list
# ---------- python_8: Python ----------
result = lines[::2]
# ---------- end python_8 ----------
panel_9 = Panel(python_8)

# ---- group: Select last line
python_9 = GhPythonScript(lines=lines_3)  # -> result; inputs lines: list
# ---------- python_9: Python ----------
result = lines[-1]
# ---------- end python_9 ----------
panel_10 = Panel(python_9)
