# Grasshopper definition 01-grasshopper-python-basics-iii_hs24.gh (Grasshopper 1.0.7)

# ----
# Different ways of defining INPUT
# Tip: use control+alt+left click on
# any component to see where it comes from!
# Fixed values
integer = Integer(42)
panel = Panel(integer)

float = Number(3.14)
panel_2 = Panel(float)

boolean = Boolean(True)
panel_3 = Panel(boolean)

panel_4 = Panel("Hello World")

# ----
# Referenced geometry
# Internalized geometry
point = Point(<point referenced from the Rhino model>)
panel_5 = Panel(point)

# ----
# Tip: use "bake" to create geometry in Rhino
point_2 = Point(Point(0.5, 3, 0))
panel_6 = Panel(point_2)

# ---- group: Variable values
integers = Slider(42, range=0..50)
panel_7 = Panel(integers)

panel_8 = Panel(Toggle(True))

floats = Slider(3.14, range=0..10)
panel_9 = Panel(floats)

# ----
# Constructed geometry
integers_2 = Slider(9, range=0..50)
integers_3 = Slider(8, range=0..50)
integers_4 = Slider(5, range=0..50)
pt = ConstructPoint(XCoordinate=integers_2, YCoordinate=integers_3, ZCoordinate=integers_4)
panel_10 = Panel(pt)

# ----
# Explicitely defined lists
integers_5 = Slider(3, range=0..50)
integers_6 = Slider(4, range=0..50)
integers_7 = Slider(5, range=0..50)
# Tip: hold shift while connecting wires to append
# the wire, conversely, hold control to disconnect.
integers_8 = Slider(6, range=0..50)
data = Data([integers_5, integers_8, integers_6, integers_7])
panel_11 = Panel(data)

# ----
# Computed lists
number_slider = Slider(3, range=0..100)
series = Series(Start=number_slider, Step=1, Count=Slider(4, range=0..100))
panel_12 = Panel(series)

# ----
# List of geometries
series_2 = Series(Start=0, Step=1, Count=10)
integers_9 = Slider(9, range=0..50)
integers_10 = Slider(2, range=0..50)
pt_2 = ConstructPoint(XCoordinate=series_2, YCoordinate=integers_9, ZCoordinate=integers_10)
panel_13 = Panel(pt_2)

integers_11 = Slider(42, range=0..50)
# Different ways of dealing with INPUT in the PROCESS
# Tip: right-click the name of an input
# to select access type (item, list, or tree)
# One item, processed one-by-one
integers_12 = Slider(42, range=0..50)
python = GhPythonScript(x=integers_12, y=integers_11)  # -> out, a
# ---------- python: Python ----------
print x + y
# ---------- end python ----------
panel_14 = Panel(python.out)

integers_13 = Slider(6, range=0..50)
# Many items, processed one-by-one
integers_14 = Slider(3, range=0..50)
integers_15 = Slider(4, range=0..50)
integers_16 = Slider(5, range=0..50)
data_2 = Data([integers_14, integers_15, integers_16, integers_13])
python_2 = GhPythonScript(x=data_2)  # -> out, a
# ---------- python_2: Python ----------
print x ** 2
# ---------- end python_2 ----------
panel_15 = Panel(python_2.out)

integers_17 = Slider(6, range=0..50)
# Many items, processed as a list
integers_18 = Slider(3, range=0..50)
integers_19 = Slider(4, range=0..50)
integers_20 = Slider(5, range=0..50)
data_3 = Data([integers_18, integers_19, integers_20, integers_17])
python_3 = GhPythonScript(x=data_3)  # -> out, a; inputs x: list
# ---------- python_3: Python ----------
for i in x:
    print i ** 2
# ---------- end python_3 ----------
panel_16 = Panel(python_3.out)

# ----
# Basic ways of defining PROCESS
# Simple sequential process, print output
python_4 = GhPythonScript()  # -> out, a
# ---------- python_4: Python ----------
print(0)
print(1)
print(2)
print(3)
print(4)
# ---------- end python_4 ----------
panel_17 = Panel(python_4.out)

# ----
# Simple sequential process, assign output to param
python_5 = GhPythonScript()  # -> out, a
# ---------- python_5: Python ----------
a = []
a.append(0)
a.append(1)
a.append(1)
a.append(2)
a.append(3)
a.append(4)
# ---------- end python_5 ----------
panel_18 = Panel(python_5.a)

# ----
# Conditional process
# Iterative process
integers_21 = Slider(24, range=-50..50)
python_6 = GhPythonScript(value=integers_21)  # -> out, a
# ---------- python_6: Python ----------
if value > 0:
    print("Value is positive")
elif value < 0:
    print("Value is negative")
else:
    print("Value is zero")
# ---------- end python_6 ----------
panel_19 = Panel(python_6.out)

integers_22 = Slider(10, range=0..20)
python_7 = GhPythonScript(x=integers_22)  # -> out, a; inputs x: Int32
# ---------- python_7: Python ----------
for i in range(x):
    print(i)
# ---------- end python_7 ----------
panel_20 = Panel(python_7.out)

# ----
# 2D list of points with modulo filter
center_of_grid = Point(Point(20, 0, 0))
python_8 = GhPythonScript(center=center_of_grid, nx=Slider(10, range=0..20), ny=Slider(10, range=0..20))  # -> out, a; inputs center: Point3d, nx: Int32, ny: Int32
# ---------- python_8: Python ----------
import math
from random import choice
from compas.geometry import Point


def modulo_filter(x, y):
    result = (x + y) % 2 == 0
    return result
    
a = []

for ix in range(nx):
    for iy in range(ny):
        if modulo_filter(ix, iy):
            x = (center.X - nx / 2) + ix
            y = (center.Y - ny / 2) + iy

            point = Point(x, y, 0)
            a.append(point)
# ---------- end python_8 ----------
draw = Draw(cg=python_8.a)  # -> rg
#   port cg: The COMPAS geometry or datastructure to be drawn.
# ---------- draw: Python ----------
from compas.geometry import Point, Box
from compas_rhino.conversions import point_to_rhino, box_to_rhino

rg = None
if cg:
    if isinstance(cg, Point):
        rg = point_to_rhino(cg)
    elif isinstance(cg, Box):
        rg = box_to_rhino(cg)
# ---------- end draw ----------

# ----
# Combining it all to create a 2d list OUTPUT
# 2D list of points, simple
center_of_grid_2 = Point(Point(0, 0, 0))
python_9 = GhPythonScript(center=center_of_grid_2, nx=Slider(10, range=0..20), ny=Slider(10, range=0..20))  # -> out, a; inputs center: Point3d, nx: Int32, ny: Int32
# ---------- python_9: Python ----------
from compas.geometry import Point

a = []

for ix in range(nx):
    for iy in range(ny):
        x = (center.X - nx / 2) + ix
        y = (center.Y - ny / 2) + iy
        point = Point(x, y, 0)
        a.append(point)
# ---------- end python_9 ----------
draw_2 = Draw(cg=python_9.a)  # -> rg; same code as draw

# ----
# 2D list of points with random filter
center_of_grid_3 = Point(Point(40, 0, 0))
python_10 = GhPythonScript(center=center_of_grid_3, nx=Slider(10, range=0..20), ny=Slider(10, range=0..20))  # -> out, a; inputs center: Point3d, nx: Int32, ny: Int32
# ---------- python_10: Python ----------
from random import choice
from compas.geometry import Point


def random_filter():
    result = choice([True, False])
    return result

a = []

for ix in range(nx):
    for iy in range(ny):
        if random_filter():
            x = (center.X - nx / 2) + ix
            y = (center.Y - ny / 2) + iy

            point = Point(x, y, 0)
            a.append(point)
# ---------- end python_10 ----------
draw_3 = Draw(cg=python_10.a)  # -> rg; same code as draw

radius = Slider(4, range=0..20)

# ----
# 2D list of points with circle filter
center_of_grid_4 = Point(Point(60, 0, 0))
python_11 = GhPythonScript(center=center_of_grid_4, nx=Slider(10, range=0..20), ny=Slider(10, range=0..20), radius=radius)  # -> out, a; inputs center: Point3d, nx: Int32, ny: Int32
# ---------- python_11: Python ----------
import math
from compas.geometry import Point

def circle_distance_filter(x, y, center, radius):
    distance = math.sqrt((center.X - x)**2 + (center.Y - y)**2)
    return radius >= distance

a = []

for ix in range(nx):
    for iy in range(ny):
        x = (center.X - nx / 2) + ix
        y = (center.Y - ny / 2) + iy 
        if circle_distance_filter(x, y, center, radius):
            point = Point(x, y, 0)
            a.append(point)
# ---------- end python_11 ----------
draw_4 = Draw(cg=python_11.a)  # -> rg; same code as draw
