# Grasshopper definition 01-room-class.gh (Grasshopper 1.0.7)
# plug-ins: EleFront

# ---- group: Create a new CLASS for rooms
define_new_class = GhPythonScript()  # -> Room
# ---------- define_new_class: Python ----------
from compas.geometry import Point, Box

class Room(object):
    def __init__(self, name, height, color):
        self.name = name
        self.height = height
        self.color = color

    def paint(self, new_color):
        self.color = new_color

    def draw(self, x, y):
        corner1 = Point(x, y, 0)
        corner2 = Point(x + 1, y + 1, 0)
        box = Box.from_corner_corner_height(corner1, corner2, self.height / 100)
        return box
# ---------- end define_new_class ----------

# ---- group: Create instances of Room class -> objects
ghpython_script = GhPythonScript(Room=define_new_class)  # -> room
# ---------- ghpython_script: Python ----------
room = Room("Bedroom", 90, [255, 255, 170])
# ---------- end ghpython_script ----------
ghpython_script_2 = GhPythonScript(Room=define_new_class)  # -> room
# ---------- ghpython_script_2: Python ----------
room = Room("Kids room", 80, [255, 255, 170])
# ---------- end ghpython_script_2 ----------
ghpython_script_3 = GhPythonScript(Room=define_new_class)  # -> room
# ---------- ghpython_script_3: Python ----------
room = Room("Living room", 100, [255, 255, 170])
# ---------- end ghpython_script_3 ----------
ghpython_script_4 = GhPythonScript(Room=define_new_class)  # -> room
# ---------- ghpython_script_4: Python ----------
room = Room("Storage room", 90, [255, 255, 170])
# ---------- end ghpython_script_4 ----------
ghpython_script_5 = GhPythonScript(Room=define_new_class)  # -> room
# ---------- ghpython_script_5: Python ----------
room = Room("Guest room", 90, [255, 255, 170])
# ---------- end ghpython_script_5 ----------

# ----
merge = Merge(
    Data1=ghpython_script,
    Data2=ghpython_script_2,
    Data3=ghpython_script_3,
    Data4=ghpython_script_4,
    Data5=ghpython_script_5)

# ---- group: Arrange room instances into a simple 2d grid
arrange = GhPythonScript(rooms=merge, xsize=Slider(3, range=1..5), ysize=Slider(2, range=1..5))  # -> out, labels, boxes; inputs rooms: list, xsize: Int32, ysize: Int32
# ---------- arrange: Python ----------
boxes = []
labels = []
room_index = 0

for x in range(xsize):
    for y in range(ysize):
        if room_index < len(rooms):
            room = rooms[room_index]
            box = room.draw(x, y)

            boxes.append(box)
            labels.append(room.name)

            room_index += 1
# ---------- end arrange ----------

# ----
draw = Draw(cg=arrange.boxes)  # -> flatten(rg)
#   port cg: The COMPAS geometry or datastructure to be drawn.
#   port rg: The Rhino geometry object.
# ---------- draw: Python ----------
"""
Draws COMPAS geometry in Grasshopper.
"""

from ghpythonlib.componentbase import executingcomponent as component

from compas.scene import SceneObject


class CompasToRhinoGeometry(component):
    def RunScript(self, cg):
        if not cg:
            return None

        return SceneObject(item=cg).draw()
# ---------- end draw ----------

# ---- group: Add extra data
box_properties = BoxProperties(Box=draw)  # -> Center, Diagonal, Area, Volume, Degeneracy
define_text_dot = DefineTextDot(Text=arrange.labels, Location=box_properties.Center, Font="Arial", Size=14)
