# Grasshopper definition using-vscode.gh (Grasshopper 1.0.7)

using_vscode = GhPythonScript()  # -> out, a
# ---------- using_vscode: Python ----------
"""
---------------
Using VS Code as Python editor
------------------------------

To use VS Code as our editor, we need to things: 

1. Tell Grasshopper where to find the python files we wrote in VS Code
2. Reload them if they change because Grasshopper would not know otherwise

"""
# Step 1: Tell Grasshopper to ALSO look in the current directory when importing anything
#         The "current directory" is the one in which you have saved this .gh file.
#         NOTE: This is only needed for GH in Mac, on Windows, this wouldn't be needed but we keep it for consistency
import os
import sys

dirname = os.path.dirname(ghenv.Component.OnPingDocument().FilePath)
if dirname not in sys.path:
    sys.path.append(dirname)

# Step 2: Unload modules so that they are reloaded the next time we import them)
from compas_rhino import unload_modules

# -----------------------------------------
# DONE: Now we can write our program below!
# -----------------------------------------

# Unload first
unload_modules("unicorns")

from unicorns import Unicorn

a = Unicorn("natalie", "green", 1000)
print(a)
# ---------- end using_vscode ----------
panel = Panel(using_vscode.out)
